# Grasshopper definition ul_Activities_time2.gh (Grasshopper 1.0.7)
# plug-ins: MeerkatGIS, EleFront, Human

path = FilePath("C:\Loc2Route\230601_routes\20230601_134913_finalDataRoute_Route_coffee_walking.json")
path_2 = FilePath("C:\Loc2Route\230525_locations\20230525_135710_locations_Coffee_150m.json")
file = ReadFile(PerLineParse=True)  # -> C
#   port F: Uri of file to read
# ---------- file: VB line parser ----------
    action = GH_LineParserAction.Include
    Return line

    'Parse the line and return some data that represents the line.
    'If the line cannot be parsed, you can return Nothing and
    'assign a different action.
    'The default implementation is to just return the line itself.
    'If you return types that implement IGH_Goo, this component
    'will work substantially faster.
# ---------- end file ----------
path_3 = FilePath("C:\Users\evallina\Dropbox\_eMiniProjects\210124_eRoutes\_urbanlensesRepos\urbanlenses\ul_GSP\_meerkat\bldg_outlines2.mkgis")
path_4 = FilePath("C:\Loc2Route\230601_locations\20230601_134913_locations_coffee_150m.json")
path_5 = FilePath("C:\Loc2Route\230602_locations\20230602_195344_locations_Bars-Pub-breweries_150m.json")
parse_mkgis = ParseMeerkatFile(MeerkatFile=path_3)  # -> DateCropped, UserAndMachineNamed, PathForFiles, ShapeType, ShapeCountInSource, BoundsInPointSpace, BoundsInLatLong, FieldNames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
python = GhPythonScript(x=path_2)  # -> out, a, simplify(b)
# ---------- python: Python ----------
__author__ = "evallina"
__version__ = "2023.05.25"

import rhinoscriptsyntax as rs


import json
import Rhino
import ghpythonlib.treehelpers as th

# Read the JSON data
with open(x, 'r') as file:  # 'x' corresponds to the file path input
    data = json.load(file)

keys = []
values = {}

# Get the first data entry keys
first_entry = next(iter(data.values()))
keys = list(first_entry.keys())

# Initialize values with empty lists for each key
for key in keys:
    values[key] = []

# Iterate over the items in the data
for _, value in data.items():
    for sub_key, sub_value in value.items():
        values[sub_key].append(sub_value)

# Convert values to a data tree, with each branch corresponding to a key
b = th.list_to_tree(list(values.values()))

# Output the keys and values
a = keys
# ---------- end python ----------
givemethatjson_please = GhPythonScript(locFile=path_4, on=Toggle(True))  # -> address, hours_close_hours, hours_opening_days, hours_start_hours, hours_time_window, icon, lat, lng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; inputs on: Boolean
#   port hours_close_hours: hours_close_hours
#   port hours_opening_days: hours_opening_days
#   port hours_start_hours: hours_start_hours
#   port hours_time_window: hours_time_window
# ---------- givemethatjson_please: Python ----------
__author__ = "evallina"
__version__ = "2023.05.31"

import rhinoscriptsyntax as rs
import json
import Grasshopper.Kernel as ghk
import Grasshopper.Kernel.Parameters as ghParams
import Grasshopper.Kernel.Data as ghData
import Grasshopper as gh
import scriptcontext as sc

# Read the JSON file
def read_json_file(file_path):
    with open(file_path, 'r') as json_file:
        data = json.load(json_file)
    return data

# Create Outputs
def collect_data(data, output_dict, path = []):
    for key, value in data.items():
        new_path = list(path)
        new_path.append(key)
        if isinstance(value, dict):
            collect_data(value, output_dict, new_path)
        elif isinstance(value, list):
            output_name = '_'.join(new_path)
            if output_name not in output_dict:
                output_dict[output_name] = []
            output_dict[output_name].append(value)
        else:
            output_name = '_'.join(new_path)
            if output_name not in output_dict:
                output_dict[output_name] = []
            output_dict[output_name].append(value)
            
            
def create_outputs(output_dict):
    output_list = []  # Step 1
    for output_name in sorted(output_dict.keys()):
        values = output_dict[output_name]
        output_index = ghenv.Component.Params.Output.Count
        p = ghParams.Param_GenericObject()
        p.Name = output_name
        p.NickName = output_name
        
        p.Description = output_name
        p.Access = ghk.GH_ParamAccess.tree
        ghenv.Component.Params.RegisterOutputParam(p)
        ghenv.Component.Params.OnParametersChanged()
        ghenv.Component.Attributes.PerformLayout()
        ghenv.Component.OnPingDocument().ScheduleSolution(1, lambda: ghenv.Component.ExpireSolution(False))
        
        output_list.append(output_name)  # Step 2

        for i, value in enumerate(values):
            path = ghData.GH_Path(i)
            if isinstance(value, list):
                for j, sub_value in enumerate(value):
                    ghenv.Component.Params.Output[output_index].AddVolatileData(path, j, sub_value)
            else:
                ghenv.Component.Params.Output[output_index].AddVolatileData(path, 0, value)

    # Step 3
    output_index = ghenv.Component.Params.Output.Count
    p = ghParams.Param_GenericObject()
    p.Name = 'Output_Names'
    p.NickName = 'Output_Names'
    p.Description = 'List of generated outputs'
    p.Access = ghk.GH_ParamAccess.list
    ghenv.Component.Params.RegisterOutputParam(p)
    ghenv.Component.Params.OnParametersChanged()
    ghenv.Component.Attributes.PerformLayout()
    ghenv.Component.OnPingDocument().ScheduleSolution(1, lambda: ghenv.Component.ExpireSolution(False))
    for i, output_name in enumerate(output_list):
        ghenv.Component.Params.Output[output_index].AddVolatileData(ghData.GH_Path(0), i, output_name)


# Erase Outputs
def erase_outputs():
    for i in range(ghenv.Component.Params.Output.Count-1, -1, -1):
        ghenv.Component.Params.UnregisterOutputParameter(ghenv.Component.Params.Output[i])
    ghenv.Component.Params.OnParametersChanged()
    ghenv.Component.Attributes.PerformLayout()

# Use the functions
if on:
    data = read_json_file(locFile)
    output_dict = {}
    for entry in data.values():
        collect_data(entry, output_dict)
    create_outputs(output_dict)
else:
    erase_outputs()
# ---------- end givemethatjson_please ----------
givemethatjson_please_2 = GhPythonScript(locFile=path_5, on=Toggle(True))  # -> address, hours_close_hours, hours_opening_days, hours_start_hours, hours_time_window, icon, lat, lng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; inputs on: Boolean; same code as givemethatjson_please
panel = Panel(python.a)
geometry_per_shape = EFDataDescription(parse_mkgis.GeometryPerShape)
area = Area(Geometry=parse_mkgis.BoundsInPointSpace)  # -> Area, Centroid
hours_close_hours = EFDataDescription(givemethatjson_please.hours_close_hours)
hours_opening_days = EFDataDescription(givemethatjson_please.hours_opening_days)
hours_start_hours = EFDataDescription(givemethatjson_please.hours_start_hours)
hours_time_window = EFDataDescription(givemethatjson_please.hours_time_window)
lat = EFDataDescription(givemethatjson_please.lat)
lng = EFDataDescription(givemethatjson_please.lng)
search = EFDataDescription(givemethatjson_please.search)
hours_close_hours_2 = EFDataDescription(givemethatjson_please_2.hours_close_hours)
hours_opening_days_2 = EFDataDescription(givemethatjson_please_2.hours_opening_days)
hours_start_hours_2 = EFDataDescription(givemethatjson_please_2.hours_start_hours)
hours_time_window_2 = EFDataDescription(givemethatjson_please_2.hours_time_window)
lat_2 = EFDataDescription(givemethatjson_please_2.lat)
lng_2 = EFDataDescription(givemethatjson_please_2.lng)
search_2 = EFDataDescription(givemethatjson_please_2.search)
vec2pt = Vector2Pt(PointA=area.Centroid, PointB=Point(0, 0, 0), Unitize=False)  # -> Vector, Length
move = Move(Motion=vec2pt.Vector)  # -> Geometry, Transform
transform = Transform(move.Transform)
transform_2 = Transform(Geometry=geometry_per_shape, Transform=transform)
path_6 = FilePath("C:\Users\evallina\Dropbox\_eMiniProjects\210124_eRoutes\_urbanlensesRepos\urbanlenses\ul_GSP\_meerkat\Building_Outlines_2015.prj")

# ---- group: Let's put this GeoCoord in their right place
path_7 = FilePath("C:\Users\evallina\Dropbox\_eMiniProjects\210124_eRoutes\_urbanlensesRepos\urbanlenses\ul_GSP\_meerkat\Building_Outlines_2015.prj")
lat_long_to_point = LatLongToPoint(Latitude=lat_2, Longitude=lng_2, ProjectionFile=path_7)
transform_3 = Transform(move.Transform)
transform_4 = Transform(Geometry=lat_long_to_point, Transform=transform_3)

# ----
lat_long_to_point_2 = LatLongToPoint(Latitude=lat, Longitude=lng, ProjectionFile=path_6)
pline = PolyLine(Vertices=transform_2, Closed=True)
lat_long_to_point_3 = LatLongToPoint()
transform_5 = Transform(move.Transform)
geo = Geometry(pline)
transform_6 = Transform(Geometry=lat_long_to_point_2, Transform=transform_5)
day_of_the_week = ValueList({"Sunday": 0, "Monday": 1, "Tuesday": 2, "Wednesday": 3, "Thursday": 4, "Friday": 5, "Saturday": 6}, selected="Tuesday")
time_of_the_day = Slider(11, range=0..23)
hours_opening_days_3 = EFDataDescription(hours_opening_days)
hours_time_window_3 = EFDataDescription(hours_time_window)
hours_close_hours_3 = EFDataDescription(hours_close_hours)
hours_start_hours_3 = EFDataDescription(hours_start_hours)
previewlw = CustomPreviewLineweights(Geometry=geo, Shader=ColourSwatch(SwatchColor=RGB(0, 28, 54)), Absolute=False)
places_locations = EFDataDescription(transform_6)
hours_opening_days_4 = EFDataDescription(hours_opening_days_2)
search_3 = EFDataDescription(search)
hours_time_window_4 = EFDataDescription(hours_time_window_2)
hours_close_hours_4 = EFDataDescription(hours_close_hours_2)
hours_start_hours_4 = EFDataDescription(hours_start_hours_2)
places_locations_2 = EFDataDescription(transform_4)
search_4 = EFDataDescription(search_2)
day_of_the_week_2 = EFDataDescription(day_of_the_week)
day_of_the_week_3 = EFDataDescription(day_of_the_week_2)
time_of_the_day_2 = EFDataDescription(time_of_the_day)
time_of_the_day_3 = EFDataDescription(time_of_the_day_2)
day_of_the_week_4 = EFDataDescription(day_of_the_week_2)
python_2 = GhPythonScript(day=day_of_the_week_2, time=time_of_the_day_2)  # -> out, dayText, timeText; inputs day: Int32, time: Int32
# ---------- python_2: Python ----------
__author__ = "evallina"
__version__ = "2023.06.01"

import rhinoscriptsyntax as rs

import datetime

# Define the input parameters
day = int(day)
time = int(time)

# Convert the day integer to day name
day_names = [ 'Sunday', 'Monday', 'Tuesday', 'Wednesday', 'Thursday', 'Friday', 'Saturday']
dayText = day_names[day]

# Format the time as "hh:mm"
timeText = datetime.time(time).strftime("%H:%M")

# Output the results
dayText, timeText
# ---------- end python_2 ----------
item = ListItem(List=hours_opening_days_3, Index=day_of_the_week_4, Wrap=True)
places_locations_3 = EFDataDescription(places_locations)
pt = ConstructPoint(XCoordinate=Slider(22, range=0..300), YCoordinate=Slider(46, range=0..300), ZCoordinate=0)
pt_2 = ConstructPoint(XCoordinate=Slider(22, range=0..300), YCoordinate=Slider(66, range=0..300), ZCoordinate=0)
dispatch = Dispatch(List=places_locations_3, DispatchPattern=item)  # -> ListA, ListB
places_locations_4 = EFDataDescription(places_locations)
places_locations_5 = EFDataDescription(places_locations)
hours_time_window_5 = EFDataDescription(hours_time_window_3)
texttoscreen = RenderTextToScreen(Text=python_2.dayText, Location=pt, Size=20, Color=RGB(255, 255, 255), Font="Arial", m_scWithvp=False)
texttoscreen_2 = RenderTextToScreen(Text=python_2.timeText, Location=pt_2, Size=10, Color=RGB(255, 255, 255), Font="Arial", m_scWithvp=False)
hours_close_hours_5 = EFDataDescription(hours_close_hours_3)
hours_close_hours_6 = EFDataDescription(hours_close_hours_3)
hours_start_hours_5 = EFDataDescription(hours_start_hours_3)
places_locations_6 = EFDataDescription(places_locations)
sel_locations = EFDataDescription(dispatch.ListA)
item_2 = ListItem(List=hours_start_hours_5, Index=day_of_the_week_4, Wrap=True)
item_3 = ListItem(List=hours_close_hours_5, Index=day_of_the_week_4, Wrap=True)
item_4 = ListItem(List=hours_time_window_5, Index=day_of_the_week_4, Wrap=True)
cir = Circle(Plane=sel_locations, Radius=20)
sel_time_window = EFDataDescription(item_4)
places_locations_7 = EFDataDescription(places_locations_6)
sel_open_hours = EFDataDescription(item_2)
sel_close_hours = EFDataDescription(item_3)
sel_locations_2 = EFDataDescription(sel_locations)
dom = ConstructDomain(DomainStart=0, DomainEnd=24)
dom_2 = ConstructDomain(DomainStart=Slider(50, range=50..250), DomainEnd=Slider(309, range=50..450))
python_3 = GhPythonScript(open_time=sel_open_hours, close_time=sel_close_hours)  # -> out, a; inputs open_time: Int32, close_time: Int32
# ---------- python_3: Python ----------
__author__ = "evallina"
__version__ = "2023.06.01"

import rhinoscriptsyntax as rs

dayTimesList=[]

for i in range(23):
    if open_time<= i <=close_time:
        dayTimesList.append(True)
    else:
        dayTimesList.append(False)
        
a=dayTimesList
# ---------- end python_3 ----------
places_locations_8 = EFDataDescription(places_locations_4)
remap = RemapNumbers(Value=sel_time_window, Source=dom, Target=dom_2)  # -> Mapped, Clipped
time_of_the_day_4 = EFDataDescription(time_of_the_day_2)
item_5 = ListItem(List=python_3.a, Index=time_of_the_day_4, Wrap=True)  # -> simplify(Item)
cir_2 = Circle(Plane=places_locations_8, Radius=remap.Mapped)
panel_2 = Panel("""30
15""")
dispatch_2 = Dispatch(List=sel_locations_2, DispatchPattern=item_5)  # -> ListA, ListB
dash = DashPattern(Curve=cir_2, Pattern=panel_2)  # -> Dashes, Gaps
places_opened = EFDataDescription(dispatch_2.ListA)
previewlw_2 = CustomPreviewLineweights(Geometry=dash.Dashes, Shader=ColourSwatch(SwatchColor=RGB(0, 191, 255)), Absolute=False)
cir_3 = Circle(Plane=places_opened, Radius=remap.Mapped)
swatch = ColourSwatch(SwatchColor=RGB(255, 0, 0))
swatch_2 = ColourSwatch(SwatchColor=RGB(255, 0, 187))

# ---- group: Opened Place at that Time
srf = Surface(cir)
preview = CustomPreview(Geometry=srf, Material=ColourSwatch(SwatchColor=RGB(255, 208, 0)))

# ----
srf_2 = Surface(cir_3)
preview_2 = CustomPreview(Geometry=srf_2, Material=ColourSwatch(SwatchColor=RGB(129, 140, 0)))
places_opened_2 = EFDataDescription(places_opened)

# ---- group: Create Grid of Points for Gradient Map
places_locations_9 = EFDataDescription(places_locations_5)
places_locations_10 = EFDataDescription(flatten(places_locations_9))
cornersarea = GhPythonScript(x=places_locations_10)  # -> out, a; inputs x: list of Point3d
# ---------- cornersarea: Python ----------
__author__ = "evallina"
__version__ = "2023.06.01"

import rhinoscriptsyntax as rs
import Rhino.Geometry as rg

# Check if the input list is not empty
if x:
    # Get the minimum and maximum points based on x and y coordinates
    min_point = rg.Point3d(min(x, key=lambda point: point.X).X, max(x, key=lambda point: point.Y).Y, 0)
    max_point = rg.Point3d(max(x, key=lambda point: point.X).X, min(x, key=lambda point: point.Y).Y, 0)
else:
    # If the input list is empty, set the default points
    min_point = rg.Point3d(0, 0, 0)
    max_point = rg.Point3d(0, 0, 0)

# Output the minimum and maximum points
a=[max_point, min_point ]
# ---------- end cornersarea ----------
item_6 = ListItem(List=cornersarea.a, Index=0, Wrap=True)  # -> Item, Item1
rec_2pt = Rectangle2Pt(Plane=PlaneXY(0, 0, 0), PointA=item_6.Item, PointB=item_6.Item1, Radius=0)  # -> Rectangle, Length
number_slider = Slider(25, range=10..60)
offset = OffsetCurve(Curve=rec_2pt.Rectangle, Distance=1000, Corners=1)
sdivide = DivideSurface(Surface=offset, UCount=number_slider, VCount=number_slider)  # -> Points, Normals, Parameters
points_grid = EFDataDescription(sdivide.Points)

# ---- group: Gradient Map
places_opened_3 = EFDataDescription(flatten(places_opened_2))
points_grid_2 = EFDataDescription(flatten(points_grid))
pull = PullPoint(Point=points_grid_2, Geometry=places_opened_3, ClosestOnly=True)  # -> ClosestPoint, Distance
number_slider_2 = Slider(0, range=0..100)
number_slider_3 = Slider(100, range=0..100)
points_grid_3 = EFDataDescription(points_grid_2)
bnd = Bounds(Numbers=pull.Distance)
dom_3 = ConstructDomain(DomainStart=number_slider_2, DomainEnd=number_slider_3)
remap_2 = RemapNumbers(Value=expr("x*5", pull.Distance), Source=bnd, Target=dom_3)  # -> Mapped, Clipped
gradient = Gradient(
    LowerLimit=number_slider_2,
    UpperLimit=number_slider_3,
    Parameter=remap_2.Mapped,
    stops=[0: RGB(220, 0, 40), 1: RGB(0, 37, 61)])
del = DelaunayMesh(Points=points_grid_3, Plane=PlaneXY(0, 0, 0))
mcol = MeshColours(Mesh=del, Colours=gradient)
